# Grasshopper definition poem-waveform.gh (Grasshopper 1.0.6)
# plug-ins: MosquitoAudio2, EdiTree

number_slider = Slider(12, range=0..250)
path = FilePath("D:\Users\pfernb1\Downloads\Markov Poem_love-meddling-and-hindsight (online-audio-converter.com).mp3")
audiowave = AudioWave(AudioFile=path, XOffset=Slider(0.25, range=0..1), Skip=Slider(3850, range=0..5000))  # -> Peak, Points, Length
play = AudioPlay(AudioFile=path, Boolean=Toggle(False))
split = SplitList(List=audiowave.Points, Index=Slider(1227, range=0..9500))  # -> ListA, ListB
dom = ConstructDomain(DomainStart=0, DomainEnd=expr("x-1", number_slider))
split_2 = SplitList(List=split.ListA, Index=Slider(890, range=0..9500))  # -> ListA, ListB
range = Range(Domain=dom, Steps=expr("x-1", number_slider))
divide_list = DivideList(List=split_2.ListB, Number=number_slider)  # -> Chunk, Remainder
vec = VectorXYZ(XComponent=0, YComponent=expr("x*2", graft(range)), ZComponent=0)  # -> Vector, Length
intcrv = Interpolate(Vertices=divide_list.Chunk, Degree=3, Periodic=False, KnotStyle=1)  # -> Curve, Length, Domain
move = Move(Geometry=intcrv.Curve, Motion=vec.Vector)  # -> Geometry, Transform
movetoplane = MoveToPlane(Geometry=move.Geometry, Plane=PlaneYZ(0, 0, 0), Above=True, Below=True)  # -> Geometry, Transform
crv = Curve(movetoplane.Geometry)
loft = Loft(Curves=flatten(crv), Options={Adjust=False, Closed=False, LoftEnds=0, LoftSimp=0, LoftType=0, Rebuild=10, Refit=0.01})
number_slider_2 = Slider(0.17, range=0..10)
scale_nu = ScaleNU(Geometry=loft, Plane=PlaneXY(0, 0, 0), ScaleX=1, ScaleY=1, ScaleZ=Slider(8, range=0..10))  # -> Geometry, Transform
Y = UnitY(Factor=1)
division = Division(A=number_slider_2, B=Slider(3, range=0..10))
contour = Contour(Shape=scale_nu.Geometry, Point=Point(0, 0, 0), Direction=Y, Distance=number_slider_2)
Y_2 = UnitY(Factor=division)
extr = Extrude(Base=contour, Direction=Y_2)
Z = UnitZ(Factor=Slider(1.17, range=0..10))
extr_2 = Extrude(Base=extr, Direction=Z)
