# Grasshopper definition soundwave-test.gh (Grasshopper 1.0.6)
# plug-ins: MosquitoAudio2

path = FilePath("D:\Users\pfernb1\Downloads\Markov Poem_love-meddling-and-hindsight (online-audio-converter.com).mp3")
audiowave = AudioWave(AudioFile=path, XOffset=Slider(0.09, range=0..1), Skip=Slider(2000, range=0..5000))  # -> Peak, Points, Length
play = AudioPlay(AudioFile=path, Boolean=Toggle(False))
intcrv = Interpolate(Vertices=audiowave.Points, Degree=3, Periodic=False, KnotStyle=1)  # -> Curve, Length, Domain
